# Grasshopper definition GHDebugSurface.gh (Grasshopper 1.0.7)

# ---- group: SurfaceFrom4Points
srf4pt = _4PointSurface(CornerA="{0.0, 0.0, 0.0}", CornerB="{10.0, 0.0, 0.0}", CornerC="{10.0, 10.0, 2.0}", CornerD="{0.0, 10.0, 4.0}")  # -> reparameterize(Surface)

# ---- group: SurfaceFromAGridOfPoints
srf = Surface(reparameterize(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))
srfpt = SurfacePoints(Surface=srf)  # -> Points, Weights, Greville, UCount, VCount

# ----
# NURBS Surface_Loose_Lofted surface_ All opened curves
number_slider = Slider(2, range=0..10)
panel = Panel("""{-20.0, 0.0, 0.0}
{0.0, 0.0, 10.0}
{10.0, 0.0, 0.0}""")
panel_2 = Panel("""{-15.0, 10.0, 0.0}
{0.0, 10.0, 5.0}
{20.0, 10.0, 1.0}""")
panel_3 = Panel("""{-5.0, 25.0, 0.0}
{0.0, 25.0, 20.0}
{10.0, 25.0, 0.0}""")
panel_4 = Panel("""{-5.0, 35.0, -2.0}
{0.0, 35.0, 20.0}
{5.0, 35.0, 0.0}""")
loft_opt = LoftOptions(Closed=False, Adjust=False, Rebuild=0, Refit=0, Type=Slider(1, range=0..10))
nurbs = NurbsCurve(Vertices=panel, Degree=number_slider, Periodic=False)  # -> Curve, Length, Domain
nurbs_2 = NurbsCurve(Vertices=panel_2, Degree=number_slider, Periodic=False)  # -> Curve, Length, Domain
nurbs_3 = NurbsCurve(Vertices=panel_3, Degree=number_slider, Periodic=False)  # -> Curve, Length, Domain
nurbs_4 = NurbsCurve(Vertices=panel_4, Degree=number_slider, Periodic=False)  # -> Curve, Length, Domain
merge = Merge(Data1=nurbs.Curve, Data2=nurbs_2.Curve, Data3=nurbs_3.Curve, Data4=nurbs_4.Curve)
panel_5 = Panel("""{0.5,0.5,0.0}
{0.1,0.1,0.0}
{1.0,1.0,0.0}""")
loft = Loft(Curves=merge, Options=loft_opt)
evalsrf = EvaluateSurface(Surface=reparameterize(loft), Point=panel_5)  # -> Point, Normal, UDirection, VDirection, Frame
srfpt_2 = SurfacePoints(Surface=loft)  # -> Points, Weights, Greville, UCount, VCount
panel_6 = Panel(evalsrf.VDirection)
panel_7 = Panel([srfpt_2.VCount, srfpt_2.UCount])
panel_8 = Panel(evalsrf.Point)
item = ListItem(List=panel_8, Index=Slider(3, range=0..10), Wrap=True)
panel_9 = Panel(item)

edges = BrepEdges(Brep=srf)  # -> Naked, Interior, NonManifold
srfpt_3 = SurfacePoints(Surface=srf4pt)  # -> Points, Weights, Greville, UCount, VCount
panel_10 = Panel(srfpt.Points)
panel_11 = Panel(srfpt.Weights)
panel_12 = Panel(srfpt_3.Points)
crv = Curve(reparameterize(<curve referenced from the Rhino model>))
# All these definitions were used to convalidate and developed the GeometrySharp surfaces tests.
crv_2 = Curve(reparameterize(<curve referenced from the Rhino model>))
crv_3 = Curve(reparameterize(<curve referenced from the Rhino model>))
crv_4 = Curve(reparameterize(<curve referenced from the Rhino model>))

# ---- group: Split
c_script = CSharpScript(srf=srf)  # -> out, bothSplits; inputs srf: Surface
# ---------- c_script: C# usings ----------
using System.Linq;
# ---------- c_script: C# ----------
    var split1 = srf.Split(1, 0.5);
    var srfs = split1.SelectMany(s => s.Split(0, 0.5)).ToList();
    bothSplits = srfs;
# ---------- end c_script ----------
c_script_2 = CSharpScript(srf=srf)  # -> out, surfsV, surfsU; inputs srf: Surface
# ---------- c_script_2: C# ----------
    surfsV = srf.Split(1, 0.5);
    surfsU = srf.Split(0, 0.5);
# ---------- end c_script_2 ----------
srfpt_4 = SurfacePoints(Surface=c_script.bothSplits)  # -> Points, Weights, Greville, UCount, VCount
srf_2 = Surface(reparameterize([c_script_2.surfsV, c_script_2.surfsU]))
srfpt_5 = SurfacePoints(Surface=c_script_2.surfsU)  # -> Points, Weights, Greville, UCount, VCount
srfpt_6 = SurfacePoints(Surface=c_script_2.surfsV)  # -> Points, Weights, Greville, UCount, VCount
panel_13 = Panel(srfpt_4.Points)
panel_14 = Panel(srfpt_6.Points)
panel_15 = Panel(srfpt_5.Points)
panel_16 = Panel(srfpt_6.UCount)
panel_17 = Panel(srfpt_6.VCount)
panel_18 = Panel(srfpt_5.UCount)
panel_19 = Panel(srfpt_5.VCount)
panel_20 = Panel(srfpt_4.Weights)
panel_21 = Panel(srfpt_5.Weights)
panel_22 = Panel(srfpt_6.Weights)
evalsrf_2 = EvaluateSurface(Surface=reparameterize(c_script.bothSplits), Point="{0.5,0.5,0.0}")  # -> Point, Normal, UDirection, VDirection, Frame
evalsrf_3 = EvaluateSurface(Surface=srf_2, Point="{0.5,0.5,0.0}")  # -> Point, Normal, UDirection, VDirection, Frame
panel_23 = Panel(evalsrf_2.Point)
panel_24 = Panel(evalsrf_3.Point)

# ----
c_script_3 = CSharpScript(x=crv_3)  # -> out, A; inputs x: Curve
# ---------- c_script_3: C# ----------
    A = x.Degree;
# ---------- end c_script_3 ----------
cp = ControlPoints(Curve=crv)  # -> Points, Weights, Knots
c_script_4 = CSharpScript(x=crv_2)  # -> out, A; inputs x: Curve; same code as c_script_3
cp_2 = ControlPoints(Curve=crv_2)  # -> Points, Weights, Knots

# ---- group: PointAt and VectorAt
panel_25 = Panel("""{0.5,0.5,0.0}
{0.1,0.1,0.0}
{1,1,0.0}
{0.3,0.5,0.0}""")
evalsrf_4 = EvaluateSurface(Surface=srf, Point=panel_25)  # -> Point, Normal, UDirection, VDirection, Frame
panel_26 = Panel(evalsrf_4.VDirection)
panel_27 = Panel(evalsrf_4.Point)

# ---- group: RationalDerivatives
c_script_5 = CSharpScript(srf=srf)  # -> out, derv0, dervs; inputs srf: Surface
# ---------- c_script_5: C# ----------
    Point3d pt;
    Vector3d[] derivis;
    srf.Evaluate(0.3, 0.5, 1, out pt, out derivis);
    dervs = derivis;
    derv0 = pt;
# ---------- end c_script_5 ----------
panel_28 = Panel(c_script_5.derv0)
panel_29 = Panel(c_script_5.dervs)

# ----
c_script_6 = CSharpScript(x=crv_4)  # -> out, A; inputs x: Curve; same code as c_script_3
cp_3 = ControlPoints(Curve=crv_4)  # -> Points, Weights, Knots
panel_30 = Panel(c_script_3.A)
panel_31 = Panel(cp.Knots)
item_2 = ListItem(List=c_script_5.dervs, Index=0, Wrap=True)
panel_32 = Panel(cp_2.Knots)
panel_33 = Panel(c_script_4.A)
panel_34 = Panel(c_script_6.A)
panel_35 = Panel(cp_3.Knots)
vdis = VectorDisplay(Anchor=c_script_5.derv0, Vector=item_2)
join = JoinCurves(Curves=[crv_3, crv_4, crv_2], Preserve=False)
c_script_7 = CSharpScript(x=join)  # -> out, A; inputs x: Curve; same code as c_script_3
cp_4 = ControlPoints(Curve=join)  # -> Points, Weights, Knots
panel_36 = Panel(c_script_7.A)
panel_37 = Panel(cp_4.Knots)

# ---- group: SurfaceIsocurve
c_script_8 = CSharpScript(srf=srf)  # -> out, isoV, isoU; inputs srf: Surface
# ---------- c_script_8: C# ----------
    isoV = srf.ToNurbsSurface().IsoCurve(1, 0.3);
    isoU = srf.ToNurbsSurface().IsoCurve(0, 0.3);
# ---------- end c_script_8 ----------
eval = EvaluateCurve(Curve=reparameterize(c_script_8.isoU), Parameter=0.5)  # -> Point, Tangent, Angle
cp_5 = ControlPoints(Curve=c_script_8.isoU)  # -> Points, Weights, Knots
cp_6 = ControlPoints(Curve=c_script_8.isoV)  # -> Points, Weights, Knots
panel_38 = Panel(cp_6.Points)
panel_39 = Panel(cp_6.Weights)
panel_40 = Panel(cp_5.Points)
panel_41 = Panel(cp_5.Weights)
panel_42 = Panel(eval.Point)

# ---- group: ClosestPt and ClosestParameters
panel_43 = Panel("""{2.5, 7, 5}
{2.5, 1.5, 2}
{9, 2.5, 1}
{5, 5, 1}""")
pt = Point(panel_43)
c_script_9 = CSharpScript(testPt=pt, srf=srf)  # -> out, pt, uv; inputs testPt: Point3d, srf: Surface
# ---------- c_script_9: C# ----------
    Point3d ptAt;
    Vector3d[] derivs;
    double u; double v;
    srf.ClosestPoint(testPt, out u, out v);
    uv = new string[]{u.ToString(), v.ToString()};
    srf.Evaluate(u, v, 1, out ptAt, out derivs);
    pt = ptAt;
# ---------- end c_script_9 ----------
panel_44 = Panel(c_script_9.pt)
panel_45 = Panel(c_script_9.uv)
